# Grasshopper definition Laga excel.gh (Grasshopper 0.9.76)

use_this_structure_to_explore_your_data = Panel("A1:B3")
if_the_string_is_empty_you_get_the_whole = Panel("")  # "if the string is empty you get the whole data"
dom = ConstructDomain(DomainStart=1, DomainEnd=1000)
path = FilePath("C:\Users\Carlos\Documents\test.xlsx")
path_2 = FilePath("C:\Users\Carlos\Documents\test.xlsx")
random = Random(Range=dom, Number=Slider(100, range=0..100), Seed=2)  # -> simplify(flatten(Random))
int = Integer(random)
read_data = CSharpScript(
    strDir=path,
    y=Button(),
    range=use_this_structure_to_explore_your_data,
    Reference="C:\Users\Carlos\Documents\Visual Studio 2015\Projects\laga\Laga\bin\Debug\Laga.dll")  # -> out, flatten(A); inputs strDir: String, y: Boolean, range: String
# ---------- read_data: C# ----------
    if(y){

      IOExcelRead re = new IOExcelRead(strDir, 2); //second sheet
      //now we need to deal with open and close.
      re.IORead_OpenExcelApp(true); //how we want to open...
      re.IOReadRange(range);
      List<List<string>> dtaF = re.matrixDataExcel;

      //I guess is because we are in Grasshopper rhino.
      int c = 0;
      foreach(List<string> lstStr in dtaF){
        myData.AddRange(lstStr, new GH_Path(c));
        c++;
      }

      re.CloseExcelApp(false);
    }

    A = myData;
# ---------- read_data: C# additional code ----------
  DataTree<string> myData = new DataTree<string>(); //not my fault again.
# ---------- end read_data ----------
read_sheetnames = CSharpScript(
    strDir=path_2,
    y=Button(),
    Reference="C:\Users\Carlos\Documents\Visual Studio 2015\Projects\laga\Laga\bin\Debug\Laga.dll")  # -> out, A; inputs strDir: String, y: Boolean
# ---------- read_sheetnames: C# ----------
    
    if(y){

      IOExcelRead re = new IOExcelRead(strDir);
      sheetNames = re.IORead_ExcelWorksheetNames();
    }

    A = sheetNames;
# ---------- read_sheetnames: C# additional code ----------
List<string> sheetNames = new List<string>();
# ---------- end read_sheetnames ----------
create_and_close = CSharpScript(
    x=int,
    y=Button(),
    sheetname="writehere",
    myFile="test",
    Reference="C:\Users\Carlos\Documents\Visual Studio 2015\Projects\laga\Laga\bin\Debug\Laga.dll")  # -> out, A; inputs x: list of Int32, y: Boolean, sheetname: String, myFile: String
# ---------- create_and_close: C# ----------
    if(y)
    {
      //initialize and open...
      Laga.IO.IOExcelWrite excelWrite = new IOExcelWrite(true);
      excelWrite.IOWrite_NewExcelSheet(1, sheetname);
      List<string> lstStr = new List<string>();

      foreach(int i in x) //we need to be sure.
        lstStr.Add(i.ToString());

      //now we can write.
      excelWrite.IOWriteList(lstStr, 1, 1, 'c');

      //now we need to handle the close.
      string bk = myFile + ".xlsx";
      excelWrite.CloseSaveExcelApp("C:\\Users\\Carlos\\Documents\\" + bk);
    }
# ---------- end create_and_close ----------
panel = Panel(create_and_close.out)
panel_2 = Panel(read_sheetnames.A)
panel_3 = Panel(read_data.A)
