# Grasshopper definition PointsPopulation.gh (Grasshopper 0.9.76)

number_slider = Slider(4, range=0..100)
series = Series(Start=0, Step=1, Count=number_slider)
points_population = CSharpScript(sizePop=number_slider, sizeChromosome=Slider(10, range=0..10), Reference="C:\Users\Carlos\Documents\Pop in GH\Laga.dll")  # -> out, simplify(A); inputs sizePop: Int32, sizeChromosome: Int32
# ---------- points_population: C# ----------
    Laga.GeneticAlgorithm.GenrPopulation pop = new GenrPopulation(sizePop);
    Laga.GeneticAlgorithm.point[][] popPoints = pop.PointPopulation(sizeChromosome, 0, 100, 0, 100, 0, 100);

    //we need to convert laga points to Rhino Points...
    //and we want to keep the same data structure...
    DataTree<Point3d> dtaPts = new DataTree<Point3d>();
    GH_Path mPath;
    int x = 0;

    foreach(Laga.GeneticAlgorithm.point[] chromosome in popPoints)
    {
      foreach(Laga.GeneticAlgorithm.point gen in chromosome)
      {
        mPath = new GH_Path(new int[]{x});
        dtaPts.Add(new Point3d(gen.X, gen.Y, gen.Z), mPath);
      }
      x++;
    }

    A = dtaPts;
# ---------- end points_population ----------
gradient = Gradient(
    LowerLimit=0,
    UpperLimit=number_slider,
    Parameter=series,
    stops=[0: RGB(243, 57, 0), 0.1: RGB(236, 27, 60), 0.2: RGB(210, 0, 118), 0.3: RGB(103, 0, 120), 0.4: RGB(39, 72, 161), 0.5: RGB(1, 192, 229), 0.6: RGB(18, 178, 90), 0.7: RGB(79, 186, 8), 0.8: RGB(220, 237, 32), 0.9: RGB(247, 159, 20), 1: RGB(243, 57, 0)])
panel = Panel(points_population.out)
concat = Concatenate(FragmentA="pop: ", FragmentB=series)
number_slider_2 = Slider(3.12, range=0..10)
sph = Sphere(Base=points_population.A, Radius=number_slider_2)
preview = CustomPreview(Geometry=sph, Shader=graft(gradient))
tag = TextTag3D(Location=points_population.A, Text=graft(concat), Size=number_slider_2, Colour=graft(gradient), Justification=7)
